# Dynamo graph Area_Of_Selected_Faces.dyn (Dynamo 2.0.2.6826)

select_face = DSFaceSelection()  # 1 picked in the model
select_face_2 = DSFaceSelection()  # 1 picked in the model
select_face_3 = DSFaceSelection()  # 1 picked in the model
select_face_4 = DSFaceSelection()  # 1 picked in the model
select_face_5 = DSFaceSelection()  # 1 picked in the model
select_face_6 = DSFaceSelection()  # 1 picked in the model
select_face_7 = DSFaceSelection()  # 1 picked in the model
select_face_8 = DSFaceSelection()  # 1 picked in the model
select_face_9 = DSFaceSelection()  # 1 picked in the model
select_face_10 = DSFaceSelection()  # 1 picked in the model
select_face_11 = DSFaceSelection()  # 1 picked in the model
select_face_12 = DSFaceSelection()  # 1 picked in the model
select_face_13 = DSFaceSelection()  # 1 picked in the model
list_create = List.Create(item0=select_face, item1=select_face_2, item2=select_face_3, item3=select_face_4, item4=select_face_5, item5=select_face_6, item6=select_face_7, item7=select_face_8, item8=select_face_9, item9=select_face_10, item10=select_face_11, item11=select_face_12, item12=select_face_13)
area = Surface.Area(surface=list_create)
flatten = List.Flatten(list=area)
sum = Math.Sum(values=flatten)
convert_between_units = DynamoConvert(sum, MeasurementType="Area", FromConversion="SquareMillimeter", ToConversion="SquareMeter")
select_face_14 = DSFaceSelection()  # 1 picked in the model
select_face_15 = DSFaceSelection()  # 1 picked in the model
select_face_16 = DSFaceSelection()  # 1 picked in the model
select_face_17 = DSFaceSelection()  # 1 picked in the model
select_face_18 = DSFaceSelection()  # 1 picked in the model
select_face_19 = DSFaceSelection()  # 1 picked in the model
select_face_20 = DSFaceSelection()  # 1 picked in the model
select_face_21 = DSFaceSelection()  # 1 picked in the model
select_face_22 = DSFaceSelection()  # 1 picked in the model
select_face_23 = DSFaceSelection()  # 1 picked in the model
select_face_24 = DSFaceSelection()  # 1 picked in the model
select_face_25 = DSFaceSelection()  # 1 picked in the model
select_face_26 = DSFaceSelection()  # 1 picked in the model
select_face_27 = DSFaceSelection()  # 1 picked in the model
select_face_28 = DSFaceSelection()  # 1 picked in the model
select_face_29 = DSFaceSelection()  # 1 picked in the model
select_face_30 = DSFaceSelection()  # 1 picked in the model
list_create_2 = List.Create(item0=select_face_14, item1=select_face_15, item2=select_face_16, item3=select_face_17, item4=select_face_18, item5=select_face_19, item6=select_face_20, item7=select_face_21, item8=select_face_22, item9=select_face_23, item10=select_face_24, item11=select_face_25, item12=select_face_26, item13=select_face_27, item14=select_face_28, item15=select_face_29, item16=select_face_30)
area_2 = Surface.Area(surface=list_create_2)
flatten_2 = List.Flatten(list=area_2)
sum_2 = Math.Sum(values=flatten_2)
convert_between_units_2 = DynamoConvert(sum_2, MeasurementType="Area", FromConversion="SquareMillimeter", ToConversion="SquareMeter")
select_face_31 = DSFaceSelection()  # 1 picked in the model
select_face_32 = DSFaceSelection()  # 1 picked in the model
select_face_33 = DSFaceSelection()  # 1 picked in the model
select_face_34 = DSFaceSelection()  # 1 picked in the model
select_face_35 = DSFaceSelection()  # 1 picked in the model
list_create_3 = List.Create(item0=select_face_31, item1=select_face_32, item2=select_face_33, item3=select_face_34, item4=select_face_35)
area_3 = Surface.Area(surface=list_create_3)
flatten_3 = List.Flatten(list=area_3)
sum_3 = Math.Sum(values=flatten_3)
convert_between_units_3 = DynamoConvert(sum_3, MeasurementType="Area", FromConversion="SquareMillimeter", ToConversion="SquareMeter")
select_face_36 = DSFaceSelection()  # 1 picked in the model
select_face_37 = DSFaceSelection()  # 1 picked in the model
select_face_38 = DSFaceSelection()  # 1 picked in the model
select_face_39 = DSFaceSelection()  # 1 picked in the model
select_face_40 = DSFaceSelection()  # 1 picked in the model
select_face_41 = DSFaceSelection()  # 1 picked in the model
select_face_42 = DSFaceSelection()  # 1 picked in the model
select_face_43 = DSFaceSelection()  # 1 picked in the model
select_face_44 = DSFaceSelection()  # 1 picked in the model
select_face_45 = DSFaceSelection()  # 1 picked in the model
select_face_46 = DSFaceSelection()  # 1 picked in the model
select_face_47 = DSFaceSelection()  # 1 picked in the model
select_face_48 = DSFaceSelection()  # 1 picked in the model
select_face_49 = DSFaceSelection()  # 1 picked in the model
select_face_50 = DSFaceSelection()  # 1 picked in the model
select_face_51 = DSFaceSelection()  # 1 picked in the model
select_face_52 = DSFaceSelection()  # 1 picked in the model
select_face_53 = DSFaceSelection()  # 1 picked in the model
select_face_54 = DSFaceSelection()  # 1 picked in the model
select_face_55 = DSFaceSelection()  # 1 picked in the model
select_face_56 = DSFaceSelection()  # 1 picked in the model
select_face_57 = DSFaceSelection()  # 1 picked in the model
select_face_58 = DSFaceSelection()  # 1 picked in the model
select_face_59 = DSFaceSelection()  # 1 picked in the model
select_face_60 = DSFaceSelection()  # 1 picked in the model
select_face_61 = DSFaceSelection()  # 1 picked in the model
select_face_62 = DSFaceSelection()  # 1 picked in the model
select_face_63 = DSFaceSelection()  # 1 picked in the model
select_face_64 = DSFaceSelection()  # 1 picked in the model
select_face_65 = DSFaceSelection()  # 1 picked in the model
select_face_66 = DSFaceSelection()  # 1 picked in the model
list_create_4 = List.Create(item0=select_face_36, item1=select_face_37, item2=select_face_38, item3=select_face_39, item4=select_face_40, item5=select_face_41, item6=select_face_42, item7=select_face_43, item8=select_face_44, item9=select_face_45, item10=select_face_46, item11=select_face_47, item12=select_face_48, item13=select_face_49, item14=select_face_50, item15=select_face_51, item16=select_face_52, item17=select_face_53, item18=select_face_54, item19=select_face_55, item20=select_face_56, item21=select_face_57, item22=select_face_58, item23=select_face_59, item24=select_face_60, item25=select_face_61, item26=select_face_62, item27=select_face_63, item28=select_face_64, item29=select_face_65, item30=select_face_66)
area_4 = Surface.Area(surface=list_create_4)
flatten_4 = List.Flatten(list=area_4)
sum_4 = Math.Sum(values=flatten_4)
convert_between_units_4 = DynamoConvert(sum_4, MeasurementType="Area", FromConversion="SquareMillimeter", ToConversion="SquareMeter")
select_face_67 = DSFaceSelection()  # 1 picked in the model
select_face_68 = DSFaceSelection()  # 1 picked in the model
select_face_69 = DSFaceSelection()  # 1 picked in the model
select_face_70 = DSFaceSelection()  # 1 picked in the model
select_face_71 = DSFaceSelection()  # 1 picked in the model
select_face_72 = DSFaceSelection()  # 1 picked in the model
select_face_73 = DSFaceSelection()  # 1 picked in the model
select_face_74 = DSFaceSelection()  # 1 picked in the model
list_create_5 = List.Create(item0=select_face_67, item1=select_face_68, item2=select_face_69, item3=select_face_70, item4=select_face_71, item5=select_face_72, item6=select_face_73, item7=select_face_74)
area_5 = Surface.Area(surface=list_create_5)
flatten_5 = List.Flatten(list=area_5)
sum_5 = Math.Sum(values=flatten_5)
convert_between_units_5 = DynamoConvert(sum_5, MeasurementType="Area", FromConversion="SquareMillimeter", ToConversion="SquareMeter")
watch = Watch(convert_between_units_5)
