# Dynamo graph Dimensions research 2017-03-04_A.dyn (Dynamo 1.2.1.3083)

linia_do_wymiaru = DSModelElementSelection()  # 1 picked in the model
jedna_sciana = DSModelElementSelection()  # 1 picked in the model
automatic_dimension_1 = Python(IN[0]=linia_do_wymiaru, IN[1]=jedna_sciana)
# ---------- automatic_dimension_1.python (44 lines) ----------
import clr
clr.AddReference('ProtoGeometry')
from Autodesk.DesignScript.Geometry import *

clr.AddReference('RevitAPI')
from Autodesk.Revit.DB import *

clr.AddReference('RevitNodes')
import Revit
clr.ImportExtensions(Revit.GeometryConversion)
clr.ImportExtensions(Revit.Elements)

clr.AddReference('RevitServices')
import RevitServices
from RevitServices.Persistence import DocumentManager
from RevitServices.Transactions import TransactionManager

doc = DocumentManager.Instance.CurrentDBDocument

# Input elements from revit

line = UnwrapElement(IN[0]).GeometryCurve
elements = UnwrapElement(IN[1])

# References from objects

elementsRef = ReferenceArray()
a	= []
opt = Options()
opt.ComputeReferences = True
opt.IncludeNonVisibleObjects = True
opt.View = doc.ActiveView

for obj in elements.get_Geometry(opt):
	a.append(obj)
### Create dimension line	
"""
TransactionManager.Instance.EnsureInTransaction(doc)

dim = doc.Create.NewDimension(doc.ActiveView, line, elementsRef).ToDSType(True)

TransactionManager
"""
OUT = a
# ----------------------------------------
code_block = CodeBlock { 0; 10; 1; }
slice = List.Slice(automatic_dimension_1, code_block.out0, code_block.out1, code_block.out2)
python_script = Python(IN[0]=slice)
# ---------- python_script.python (13 lines) ----------
import clr
clr.AddReference('ProtoGeometry')
from Autodesk.DesignScript.Geometry import *
#The inputs to this node will be stored as a list in the IN variables.
a = IN[0]

b = []

for item in a:
	b.append(item.Direction)

#Assign your output to the OUT variable.
OUT = b
# ----------------------------------------
automatic_dimension_1_2 = Python()  # unwired: IN[0], IN[1]
# ---------- automatic_dimension_1_2.python (44 lines) ----------
import clr
clr.AddReference('ProtoGeometry')
from Autodesk.DesignScript.Geometry import *

clr.AddReference('RevitAPI')
from Autodesk.Revit.DB import *

clr.AddReference('RevitNodes')
import Revit
clr.ImportExtensions(Revit.GeometryConversion)
clr.ImportExtensions(Revit.Elements)

clr.AddReference('RevitServices')
import RevitServices
from RevitServices.Persistence import DocumentManager
from RevitServices.Transactions import TransactionManager

doc = DocumentManager.Instance.CurrentDBDocument

# Input elements from revit

line = UnwrapElement(IN[0]).GeometryCurve
elements = UnwrapElement(IN[1])

# References from objects

elementsRef = ReferenceArray()
a	= []
opt = Options()
opt.ComputeReferences = True
opt.IncludeNonVisibleObjects = True
opt.View = doc.ActiveView

for obj in elements:
	elementsRef.Append(obj)
#	Create dimension line	

TransactionManager.Instance.EnsureInTransaction(doc)

dim = doc.Create.NewDimension(doc.ActiveView, line, elementsRef).ToDSType(True)

TransactionManager

OUT = elementsRef
# ----------------------------------------
python_script_2 = Python(IN[0]=slice)
# ---------- python_script_2.python (13 lines) ----------
import clr
clr.AddReference('ProtoGeometry')
from Autodesk.DesignScript.Geometry import *
#The inputs to this node will be stored as a list in the IN variables.
a = IN[0]

b = []

for item in a:
	b.append(item.ApproximateLength)

#Assign your output to the OUT variable.
OUT = b
# ----------------------------------------
python_script_3 = Python(IN[0]=slice)
# ---------- python_script_3.python (13 lines) ----------
import clr
clr.AddReference('ProtoGeometry')
from Autodesk.DesignScript.Geometry import *
#The inputs to this node will be stored as a list in the IN variables.
a = IN[0]

b = []

for item in a:
	b.append(item.Origin)

#Assign your output to the OUT variable.
OUT = b
# ----------------------------------------
python_script_4 = Python(IN[0]=slice)
# ---------- python_script_4.python (13 lines) ----------
import clr
clr.AddReference('ProtoGeometry')
from Autodesk.DesignScript.Geometry import *
#The inputs to this node will be stored as a list in the IN variables.
a = IN[0]

b = []

for item in a:
	b.append(item.GetEndPointReference(0))

#Assign your output to the OUT variable.
OUT = b
# ----------------------------------------
linia_do_wymiaru_2 = DSModelElementSelection()  # 1 picked in the model
python_script_5 = Python(IN[0]=slice)
# ---------- python_script_5.python (13 lines) ----------
import clr
clr.AddReference('ProtoGeometry')
from Autodesk.DesignScript.Geometry import *
#The inputs to this node will be stored as a list in the IN variables.
a = IN[0]

b = []

for item in a:
	b.append(item.Reference)

#Assign your output to the OUT variable.
OUT = b
# ----------------------------------------
code_block_2 = CodeBlock { 3; }
getItemAtIndex = List.GetItemAtIndex(list=python_script_5, index=code_block_2)
code_block_3 = CodeBlock { 1; }
getItemAtIndex_2 = List.GetItemAtIndex(list=python_script_5, index=code_block_3)
code_block_4 = CodeBlock { 0; }
getItemAtIndex_3 = List.GetItemAtIndex(list=python_script_5, index=code_block_4)
create = List.Create(getItemAtIndex, getItemAtIndex_2, getItemAtIndex_3)
flatten = Flatten(create)
automatic_dimension_1_3 = Python(IN[0]=linia_do_wymiaru_2, IN[1]=flatten)  # same code as automatic_dimension_1_2
python_script_6 = Python(IN[0]=jedna_sciana)
# ---------- python_script_6.python (7 lines) ----------
import clr
clr.AddReference('ProtoGeometry')
from Autodesk.DesignScript.Geometry import *
#The inputs to this node will be stored as a list in the IN variables.
a = UnwrapElement(IN[0])
b = a.Location.Curve
OUT = b
# ----------------------------------------
watch = Watch(python_script_6)
code_block_5 = CodeBlock { 7; }
getItemAtIndex_4 = List.GetItemAtIndex(list=python_script_5, index=code_block_5)
