# Dynamo graph GetSortedGroupedScheduleElements.dyn (Dynamo 2.0.4.12684)

# group: Node based solution
views = Views(index=29)
# note: Custom Package: Data-Shapes v.2019.2.40
all_elements_in_view_s = Custom[All Elements In View(s)](Views=views)  # Retrieves all visible element in a view or a set of views
flatten = List.Flatten(list=all_elements_in_view_s)
code_block = CodeBlock { "|"; }
python_script_getsortgroupfields = Python(IN[0]=views)
# ---------- python_script_getsortgroupfields.python (9 lines) ----------
import clr
clr.AddReference("RevitAPI")
from Autodesk.Revit.DB import *

scheduleView = UnwrapElement(IN[0])
scheduleDefinition = scheduleView.Definition
scheduleParameters = ScheduleDefinition.GetSortGroupFields(scheduleDefinition)

OUT = [scheduleDefinition.GetField(scheduleParameter.FieldId).GetName() for scheduleParameter in scheduleParameters]
# ----------------------------------------
# note: Custom Package: Rhythm v.2019.7.24
ʳʰʸᵗʰᵐ_elements = Rhythm.Revit.Elements.Elements.GetParameterValueByNameTypeOrInstance(element=flatten@L1, parameterName=python_script_getsortgroupfields)
join = String.Join(separator=code_block, string0=ʳʰʸᵗʰᵐ_elements)
flatten_2 = List.Flatten(list=join)
groupByKey = List.GroupByKey(list=flatten, keys=flatten_2)
sortByKey = List.SortByKey(list=groupByKey.groups, keys=groupByKey.unique_keys)
count = List.Count(list=sortByKey.sorted_list@L2)
