# Dynamo graph Object_Surface.dyn (Dynamo 2.0.2.6826)

select_model_element = DSModelElementSelection()  # 1 picked in the model
faces = Element.Faces(element=select_model_element)
area = Surface.Area(surface=faces)
convert_between_units = DynamoConvert(area, MeasurementType="Area", FromConversion="SquareMillimeter", ToConversion="SquareMeter")
sum = Math.Sum(values=convert_between_units)
area_2 = Watch(sum)
