# Dynamo graph Select_By_Parameter_Value.dyn (Dynamo 2.0.2.6826)

select_model_elements = DSModelElementsSelection()  # 21 picked in the model
code_block = CodeBlock { "Nové konstrukce v AXO"; "Ne"; }
python_script = Python(IN[0]=select_model_elements, IN[1]=code_block.out0, IN[2]=code_block.out1)
# ---------- python_script.python (82 lines) ----------
# Povolit podporu Python a načíst knihovnu DesignScript
import clr
clr.AddReference('ProtoGeometry')
from Autodesk.DesignScript.Geometry import *



# Umístit kód pod tento řádek

# Přiřaďte výstup k proměnné OUT.
clr.AddReference("RevitApi")
import Autodesk
import Autodesk.Revit.DB as DB
#from Autodesk.Revit.UI.Selection import Selection as UISelection
#from Autodesk.Revit.UI import UIApplication

clr.AddReference("RevitServices")
import RevitServices
from RevitServices.Persistence import DocumentManager


clr.AddReference("System")
from System.Collections.Generic import List as Clist

uiapp = DocumentManager.Instance.CurrentUIApplication

# Vstupní údaje k tomuto uzlu budou uloženy jako seznam proměnných IN.
myObjects = IN[0]
myParameterName = IN[1]
myParameterValue = IN[2]



#  Creating collector instance and collecting all the walls from the model

# Get all properties of wall
textOut = ""
#for element in myObjects:
#	param_set = element.GetOrderedParameters()
#	for param in list(param_set):
#		textOut += "ParamName - {name}; value - {value}; hasValue - {hasValue}; ParameterType - {parameterType} unitType - {unitType}" \
#				.format( \
#						name=param.Definition.Name, \
#						parameterType = param.Definition.ParameterType, \
#						value = param.AsValueString(), \
#						hasValue = param.HasValue, \
#						unitType=param.Definition.UnitType \
#						) \
#	textOut += "-----------"

def Unwrap(item, *args):
	return UnwrapElement(item)

#def ProcessList(_func, _list):
#    return map( lambda x: ProcessList(_func, x) if type(x)==list else _func(x), _list )

def ProcessList(_func, _list, *args):
    return map( lambda x: ProcessList(_func, x, *args) if type(x)==list else _func(x, *args), _list )

def filterByCustomParameterValue(inSelection, parameterName, parameterValue):
	returnSelection = []
	for element in inSelection:
		param_set = element.GetOrderedParameters()
		for parameter in param_set:
			if parameter.Definition.Name == parameterName and parameterValue == parameter.AsValueString():
				print("this elementID has right property - {0}".format(element.Id))
				returnSelection.append(element.Id)
	return returnSelection

myUnwrappedObjects = ProcessList(Unwrap, myObjects)
selectedElementsIds = filterByCustomParameterValue( \
						myUnwrappedObjects, \
						myParameterName, \
						myParameterValue)
myCollection = Clist[DB.ElementId](selectedElementsIds)
lMyCollection = list(myCollection)
print ("myCollection length - {0}".format(len(myCollection)))
print len(selectedElementsIds)
#__revit__.ActiveUIDocument.Selection.SetElementIds(myCollection)
uiapp.ActiveUIDocument.Selection.SetElementIds(myCollection)
#print __revit__.ActiveUIDocument.Selection.GetElementIds()
OUT = textOut
# ----------------------------------------
code_block_2 = CodeBlock { "Nové konstrukce v AXO"; "Ano"; }
