# Dynamo graph 3-Legged_auth_code.dyn (Dynamo 2.12.0.5650)

vlož_autorizační_kód = StringInput("t6SUTj41bbrq9H6fUFhVg9L_a8i1jKygGYZKSNE2")
length = String.Length(string=vlož_autorizační_kód)
code_block = CodeBlock { 0; }
gt = length > code_block
CLIENT_ID = Python()  # IronPython2; unwired: IN[0]
# ---------- CLIENT_ID.python (1 lines) ----------
OUT = 'Y5XrdAWZhwscrASWKXnARt2YCV0t3CHP'
# ----------------------------------------

# group: Získání autorizačního kódu z přihlašení: Po spuštění skriptu se otevře internetový prohlížeč, kde je potřeba vyplnit přihlašovací údaje , nebo je nutné kliknout na povolit. Po kliknutí povolit se vykreslí nová stránka z které zkopiruj kód z ulr adresy a vlož ho do nodu Autorizační kód: celé url: http://localhost:8080/?code=noGqvWNwanIadAIaBmVXKdYOpk9P8dAchv1kZnYE zkopíruj jenom kód za textem code= příklad: noGqvWNwanIadAIaBmVXKdYOpk9P8dAchv1kZnYE
code_block_2 = CodeBlock {  }
get_authorization_code = Python(IN[0]=CLIENT_ID)  # IronPython2
# ---------- get_authorization_code.python (116 lines) ----------
import clr
import sys
import webbrowser


# Import knihoven pro práci s okny
clr.AddReference("System.Windows.Forms")
clr.AddReference("System.Drawing")
clr.AddReference('System.Net.Http')
import System.Net.Http as Http
#import System.Windows.Forms
import System.Windows.Forms as Forms
from System.Windows.Forms import Form, Label, TextBox, Button, WebBrowser
client_id = IN[0]

# Definujte funkci pro otevření okna s přihlašovacími údaji
#OUT = dir(Http)

def get_authorization_code():
	# Spusťte HTTP server na lokálním portu pro přesměrování URI
	
	#redirect_uri = 'http%3A%2F%2Flocalhost%3A8080%2Foauth%2Fcallback%2F'
	#redirect_uri = f'http://localhost:8080'
	redirect_uri = 'http%3A%2F%2Flocalhost%3A8080'
	#listener = Http.HttpListener()
	#listener.Prefixes.Add(redirect_uri)
	#listener.Start()
	
	

	# Otevře prohlížeč s přihlašovacím URL
	#Forms.WebBrowser().Navigate(f"https://developer.api.autodesk.com/authentication/v1/authorize?response_type=code&client_id=" + client_id +"&redirect_uri=" + redirect_uri + "&scope=data:read")
	#Forms.WebBrowser().Navigate(f"http://www.idnes.cz")
	#webbrowser.open_new("https://developer.api.autodesk.com/authentication/v1/authorize?response_type=code&client_id=" + client_id +"&redirect_uri=" + redirect_uri + "&scope=data:read")
	#return webbrowser.get().func_code()
	myWeb = webbrowser.open_new("https://developer.api.autodesk.com/authentication/v2/authorize?response_type=code&client_id=Y5XrdAWZhwscrASWKXnARt2YCV0t3CHP&redirect_uri=http://localhost:8080/&scope=data:read")
	return myWeb

	# Čekáme na přesměrování na naši URI a získáme autorizační kód
	#context = listener.GetContext()
	#query = context.Request.Url.Query
	#authorization_code = Http.HttpUtility.ParseQueryString(query).Get("code")
	
	# Ukončíme HTTP listener
	#listener.Close()

	# Zobrazíme autorizační kód
	#return authorization_code
	return client_id
	
#OUT = get_authorization_code()
#OUT = sys.exc_info()
OUT = get_authorization_code()

"""
def open_login_window():
    # Vytvořte nové okno
    login_window = Form()
    login_window.Text = "Přihlašovací údaje"

    # Vytvořte label pro zobrazování textu
    label = Label()
    label.Text = "Zadejte přihlašovací údaje a získejte token."
    label.Location = System.Drawing.Point(10, 10)
    login_window.Controls.Add(label)

    # Vytvořte pole pro zadání údajů
    username_label = Label()
    username_label.Text = "Uživatelské jméno:"
    username_label.Location = System.Drawing.Point(10, 40)
    login_window.Controls.Add(username_label)

    username_textbox = TextBox()
    username_textbox.Location = System.Drawing.Point(120, 40)
    login_window.Controls.Add(username_textbox)

    password_label = Label()
    password_label.Text = "Heslo:"
    password_label.Location = System.Drawing.Point(10, 70)
    login_window.Controls.Add(password_label)

    password_textbox = TextBox()
    password_textbox.Location = System.Drawing.Point(120, 70)
    password_textbox.PasswordChar = "*"
    login_window.Controls.Add(password_textbox)

    # Vytvořte Button pro získání tokenu
    login_button = Button()
    login_button.Text = "Získej token"
    login_button.Location = System.Drawing.Point(10, 100)
    # Definujte funkci pro získání tokenu po kliknutí na Button
    def get_token():
        # Zde můžete implementovat kód pro získání tokenu podle dokumentace 3-Legged Token
        # Použijte uživatelské jméno a heslo z textboxů

        # Po získání autorizačního kódu
        authorization_code = "ZDE_VLOŽTE_ZÍSKANÝ_AUTORIZAČNÍ_KÓD"

        # Vytvoření URI s autorizačním kódem
        #authorization_uri = f"https://yourauthorizationserver.com/#authorize?code={authorization_code}"

        # Zobrazíme URI s autorizačním kódem
        label.Text = f"URI s autorizačním kódem:\n{authorization_uri}"
        #login_window.Controls.Add(label)

    login_button.Click += get_token
    login_window.Controls.Add(login_button)

    # Zobrazit okno
    login_window.ShowDialog()
"""
# Vytvořte Button pro otevření okna s přihlašovacími údaji
#open_login_button = Button()
#open_login_button.Text = "Otevřít přihlašovací okno"
#open_login_button.Click += open_login_window
    
# ----------------------------------------

if_ = RefactoredIf(test=gt, true=vlož_autorizační_kód, false=get_authorization_code)
CLIENT_SECRET = Python()  # IronPython2; unwired: IN[0]
# ---------- CLIENT_SECRET.python (1 lines) ----------
OUT = 'PKple38AUYm7FQJc'
# ----------------------------------------
get_authorization_code_2 = Python(IN[0]=if_, IN[1]=CLIENT_ID, IN[2]=CLIENT_SECRET)  # IronPython2
# ---------- get_authorization_code_2.python (37 lines) ----------
import http.client
import json
import secrets
import hashlib
import base64

# Konfigurace
authorization_code = IN[0]
client_id = IN[1]
client_secret = IN[2]

code_verifier = base64.urlsafe_b64encode(secrets.token_bytes(32)).decode('utf-8')
code_challenge = base64.urlsafe_b64encode(hashlib.sha256(code_verifier.encode('utf-8')).digest()).rstrip(b'=').decode('utf-8')


#client_secret = "YOUR_CLIENT_SECRET"
redirect_uri = 'http%3A%2F%2Flocalhost%3A8080'
authorization_url = "developer.api.autodesk.com"
token_url = "developer.api.autodesk.com"

# Vytvoření připojení k serveru pro výměnu autorizačního kódu za token
token_conn = http.client.HTTPSConnection(token_url)

# Vytvoření POST požadku pro výměnu autorizačního kódu za token
token_request_data = f"client_id={client_id}&client_secret={client_secret}&grant_type=authorization_code&code={authorization_code}&redirect_uri={redirect_uri}&code_verifier={code_verifier}"

headers = {"Content-Type": "application/x-www-form-urlencoded"}

token_conn.request("POST", "/authentication/v2/token", body=token_request_data, headers=headers)

# Získání odpovědi
token_response = token_conn.getresponse()
token_data = token_response.read()

# Výstup tokenu
print("3-Legged Token:")
OUT = (token_data.decode('utf-8'))
# ----------------------------------------
vlož_autorizační_kód_2 = StringInput("")
